# Grasshopper definition Envelope_Wires_XML.gh (Grasshopper 0.9.76)
# plug-ins: LunchBox

srf = Surface()
diagrid = DiagridStructure(Surface=srf, UDivisions=Slider(27, range=0..100), VDivisions=Slider(32, range=0..100), Type=True)  # -> StructureLines, StructureNodes
end = EndPoints(Curve=diagrid.StructureLines)  # -> graft(Start), graft(End)
merge = Merge(Data1=end.Start, Data2=end.End)
pdecon = Deconstruct(Point=merge)  # -> XComponent, YComponent, ZComponent
format = Format(Format="{0},{1},{2}", Culture=127, Data0=pdecon.XComponent, Data1=pdecon.YComponent, Data2=pdecon.ZComponent)
item = ListItem(List=format, Index=0, Wrap=True)  # -> flatten(Item), flatten(Item1)
panel = Panel("""PointA
PointB""")
entwine = Entwine(Branch00=item.Item, Branch01=item.Item1, FlattenInputs=True)
datatable = CreateDataTable(TableName="Points", TableHeaders=panel, ValueTree=entwine)
dataset = CreateDataSet(DataSetName="Wires", DataTables=datatable)
xml = CreateXML(WriteXML=Button(), FilePath="XML output location here ....", DataSet=dataset)
